# Dynamo graph basic_01_clr.dyn (Dynamo 2.17.1.4055)

file_path = Filename("C:\Users\cursos\Desktop\curso_revit_dynamo_python\basic\basic_01_clr.py")
readText = FileSystem.ReadText(file=file_path)
python_script_from_string = PythonStringNode(script=readText)  # CPython3; unwired: IN[0]
watch = Watch(python_script_from_string)
