# Dynamo graph basic_02_contextos_tipos.dyn (Dynamo 2.17.1.4055)

file_path = Filename("No file selected.")
readText = FileSystem.ReadText(file=file_path)
python_script_from_string = PythonStringNode(script=readText)  # CPython3; unwired: IN[0]
