# Dynamo graph basic_02_salidas_de_datos.dyn (Dynamo 2.18.1.5096)

file_path = Filename("C:\Users\cursos\Desktop\curso_revit_dynamo_python\basic\contextos_tipos\basic_02_salidas_de_datos.py")
readText = FileSystem.ReadText(file=file_path)
python_script_from_string = PythonStringNode(script=readText)  # CPython3
python_script = Python(IN[0]=python_script_from_string)  # CPython3
# ---------- python_script.python (1 lines) ----------
OUT = type(IN[0])
# ----------------------------------------
watch = Watch(python_script)
code_block = CodeBlock { 2; 4; 2; }
byCoordinates = Point.ByCoordinates(x=code_block.out0, y=code_block.out1, z=code_block.out2)
asVector = Point.AsVector(point=byCoordinates)
code_block_2 = CodeBlock { 5; }
byCoordinates_2 = Point.ByCoordinates(x=code_block_2)
X = Point.X(point=byCoordinates_2)
code_block_3 = CodeBlock { 7; 9; 4; }
code_block_4 = CodeBlock(X=code_block_3.out0, Y=code_block_3.out1, Z=code_block_3.out2) { Point.ByCoordinates(X,Y,Z).X; }

# group: contexto Dynamo
type = Object.Type(object=python_script_from_string)
watch_2 = Watch(type)
code_block_5 = CodeBlock(x=python_script_from_string) { DSCore.Object.Type(x); }
watch_3 = Watch(code_block_5)
